# Grasshopper definition SurfacePatternTool.gh (Grasshopper 1.0.8)

backface = Slider(17, range=0..46)
solidin = Brep(<brep referenced from the Rhino model>)
frontface = Slider(22, range=0..46)
gridoffset = Slider(0.5, range=0..0.95)
u_count = Slider(12, range=1..40)
backdepth = Slider(1.5, range=0.1..10)
v_count = Slider(8, range=1..40)
cutsolid = BooleanToggle(True)
radius = Slider(2, range=0.1..6)
cutdepth = Slider(1.5, range=0.1..10)
debrep = DeconstructBrep(Brep=solidin)  # -> Faces, Edges, Vertices
item = ListItem(List=debrep.Faces, Index=frontface, Wrap=True)
subtraction = Subtraction(A=radius, B=cutdepth)
subtraction_2 = Subtraction(A=radius, B=backdepth)
item_2 = ListItem(List=debrep.Faces, Index=backface, Wrap=True)
sdivide = DivideSurface(Surface=item, UCount=u_count, VCount=v_count)  # -> Points, Normals, Parameters
sdivide_2 = DivideSurface(Surface=item_2, UCount=u_count, VCount=v_count)  # -> Points, Normals, Parameters
pdecon = Deconstruct(Point=flatten(sdivide_2.Parameters))  # -> XComponent, YComponent, ZComponent
amp = Amplitude(Vector=sdivide.Normals, Amplitude=subtraction)
move = Move(Geometry=sdivide.Points, Motion=amp)  # -> Geometry, Transform
bnd = Bounds(Numbers=pdecon.XComponent)
bnd_2 = Bounds(Numbers=pdecon.YComponent)
sph = Sphere(Base=move.Geometry, Radius=radius)
dedomain = DeconstructDomain(Domain=bnd)  # -> Start, End
dedomain_2 = DeconstructDomain(Domain=bnd_2)  # -> Start, End
subtraction_3 = Subtraction(A=dedomain.End, B=dedomain.Start)
subtraction_4 = Subtraction(A=dedomain_2.End, B=dedomain_2.Start)
division = Division(A=subtraction_3, B=u_count)
division_2 = Division(A=subtraction_4, B=v_count)
multiplication = Multiplication(A=division, B=gridoffset)
multiplication_2 = Multiplication(A=division_2, B=gridoffset)
addition = Addition(A=dedomain.Start, B=multiplication)
addition_2 = Addition(A=dedomain_2.Start, B=multiplication_2)
series = Series(Start=addition, Step=division, Count=u_count)
series_2 = Series(Start=addition_2, Step=division_2, Count=v_count)
crossref = CrossReference(ListA=series, ListB=series_2, CrossMode=1)  # -> ListA, ListB
pt = ConstructPoint(XCoordinate=crossref.ListA, YCoordinate=crossref.ListB, ZCoordinate=0)
evalsrf = EvaluateSurface(Surface=item_2, Point=pt)  # -> Point, Normal, UDirection, VDirection, Frame
amp_2 = Amplitude(Vector=evalsrf.Normal, Amplitude=subtraction_2)
move_2 = Move(Geometry=evalsrf.Point, Motion=amp_2)  # -> Geometry, Transform
sph_2 = Sphere(Base=move_2.Geometry, Radius=radius)
merge = Merge(Data1=sph, Data2=sph_2)
gate = StreamGate(Stream=merge, Gate=cutsolid)  # -> Target0, Target1
sdiff = SolidDifference(BrepsA=solidin, BrepsB=flatten(gate.Target1))
cutterpreview = Geometry(gate.Target0)
